# Grasshopper definition All orientation-Galapagos.gh (Grasshopper 1.0.7)
# Copyright: © 2017-2018 Pierre Cuvilliers, Caitlin Mueller, Massachusetts Institute of Technology
# plug-ins: ClimateStudioGH, Colibri

# ----
# Locations
location = ValueList({"Quito (0ºN)": "ECU_PC_Quito-Parque-Bicentenario.840710_TMYx", "Caracas (10ºN)": "VEN_Caracas.804150_IWEC", "Puerto Rico (18ºN)": "PRI_San.Juan-Luis.Munoz.Marin.Intl.AP.785263_TMY3", "Miami (25ºN)": "USA_FL_Miami.Intl.AP.722020_TMY3", "Houston (30ºN)": "USA_TX_Houston-Bush.Intercontinental.AP.722430_TMY3", "Phoenix (33ºN)": "USA_AZ_Phoenix-Sky.Harbor.Intl.AP.722780_TMY3", "San Francisco (38ºN)": "USA_CA_San.Francisco.Intl.AP.724940_TMY3", "New York (40ºN)": "USA_NY_New.York-LaGuardia.AP.725030_TMY3", "Boston (42ºN)": "USA_MA_Boston-Logan.Intl.AP.725090_TMY3", "Seattle (47ºN)": "USA_WA_Seattle-Tacoma.Intl.AP.727930_TMY3", "Edmonton (53ºN)": "CAN_AB_Edmonton.711230_CWEC", "Anchorage (61ºN)": "USA_AK_Anchorage.Stevens.Intl.AP.702730_TMY3"}, selected="San Francisco (38ºN)")

# ----
# Room
# Room: Geometry Input
room_width_ft = Slider(20, range=18..22)
room_depth_ft = Slider(30, range=28..32)
# South Window
# Sill height(3') fixed
room_height_ft = Slider(10, range=9..12)

# ----
# Overhangs Input
overhang_rotation_angle = Slider(0, range=0..4, expression="5*x")
total_overhangs = Slider(0, range=0..4)
overhang_depth = Slider(0, range=0..4)

# ----
# Window Input
# Sill height (3ft) fixed
window_width_ft = Slider(5, range=5..22)
window_height_ft = Slider(4, range=4..13)
sill_height_3ft = Number(3)

# ----
# Fins Input
# South Shadings
fins_rotation_angle = Slider(-1, range=-1..1, expression="5*x")
total_fins = Slider(2, range=2..4)
fin_depth = Slider(0, range=0..4)

# ----
# Inputs
room = DomainBox(Base=PlaneXY(0, 0, 0), X=room_width_ft, Y=room_depth_ft, Z=room_height_ft)
brep = Brep(room)
debrep = DeconstructBrep(Brep=brep)  # -> Faces, Edges, Vertices

# ----
# South Facade (Transparent)
# (Room width - Window width)/2
# Distance from window to the wall edge
# Room height - (Window height+sill height)
# Distance from window to the ceiling
number_slider = Slider(9, range=1..12)
subtraction = Subtraction(A=room_width_ft, B=window_width_ft)
addition = Addition(A=sill_height_3ft, B=window_height_ft)
division = Division(A=subtraction, B=2)
subtraction_2 = Subtraction(A=room_height_ft, B=addition)
X = UnitX(Factor=division)
item = ListItem(List=debrep.Edges, Index=number_slider, Wrap=True)
item_2 = ListItem(List=debrep.Edges, Index=Slider(8, range=1..12), Wrap=True)
move = Move(Geometry=item, Motion=expr("-x", X))  # -> Geometry, Transform
move_2 = Move(Geometry=item_2, Motion=X)  # -> Geometry, Transform
end = EndPoints(Curve=move.Geometry)  # -> Start, End
end_2 = EndPoints(Curve=move_2.Geometry)  # -> Start, End
devec = DeconstructVector(Vector=end.End)  # -> XComponent, YComponent, ZComponent
devec_2 = DeconstructVector(Vector=end.Start)  # -> XComponent, YComponent, ZComponent
devec_3 = DeconstructVector(Vector=end_2.Start)  # -> XComponent, YComponent, ZComponent
subtraction_3 = Subtraction(A=devec_3.ZComponent, B=subtraction_2)
devec_4 = DeconstructVector(Vector=end_2.End)  # -> XComponent, YComponent, ZComponent
addition_2 = Addition(A=devec_4.ZComponent, B=sill_height_3ft)
subtraction_4 = Subtraction(A=devec.ZComponent, B=subtraction_2)
addition_3 = Addition(A=devec_2.ZComponent, B=sill_height_3ft)
pt_topright = ConstructPoint(XCoordinate=devec.XComponent, YCoordinate=devec.YComponent, ZCoordinate=subtraction_4)
pt_topleft = ConstructPoint(XCoordinate=devec_3.XComponent, YCoordinate=devec_3.YComponent, ZCoordinate=subtraction_3)
pt_bottomleft = ConstructPoint(XCoordinate=devec_4.XComponent, YCoordinate=devec_4.YComponent, ZCoordinate=addition_2)
pt_bottomright = ConstructPoint(XCoordinate=devec_2.XComponent, YCoordinate=devec_2.YComponent, ZCoordinate=addition_3)
southglazing = _4PointSurface(CornerA=pt_topright, CornerB=pt_bottomright, CornerC=pt_bottomleft, CornerD=pt_topleft)
flip = Flip(Surface=southglazing)  # -> Surface, Result

# ----
# Vertical fin shading (Fins)
Z = UnitZ(Factor=subtraction_2)
ln = Line(StartPoint=pt_bottomright, EndPoint=pt_bottomleft)
ln_2 = Line(StartPoint=pt_topright, EndPoint=pt_topleft)
subtraction_5 = Subtraction(A=total_fins, B=1)
move_3 = Move(Geometry=ln_2, Motion=Z)  # -> Geometry, Transform; disabled
divide = DivideCurve(Curve=ln, Count=subtraction_5, Kinks=False)  # -> Points, Tangents, Parameters
divide_2 = DivideCurve(Curve=ln_2, Count=subtraction_5, Kinks=False)  # -> Points, Tangents, Parameters
ln_3 = Line(StartPoint=divide.Points, EndPoint=divide_2.Points)
Y = UnitY(Factor=expr("-x", fin_depth))
rad = Radians(Degrees=fins_rotation_angle)
fins = Extrude(Base=ln_3, Direction=Y)
rotax = RotateAxis(Geometry=fins, Angle=rad, Axis=ln_3)  # -> Geometry, Transform

# ----
# Overhangs
ln_4 = Line(StartPoint=pt_topright, EndPoint=pt_bottomright)
ln_5 = Line(StartPoint=pt_topleft, EndPoint=pt_bottomleft)
rad_2 = Radians(Degrees=overhang_rotation_angle)
divide_3 = DivideCurve(Curve=ln_4, Count=total_overhangs, Kinks=False)  # -> Points, Tangents, Parameters
Y_2 = UnitY(Factor=expr("-x", overhang_depth))
divide_4 = DivideCurve(Curve=ln_5, Count=total_overhangs, Kinks=False)  # -> Points, Tangents, Parameters
ln_6 = Line(StartPoint=divide_3.Points, EndPoint=divide_4.Points)
cull_i = CullIndex(List=ln_6, Indices=total_overhangs, Wrap=True)
overhangs = Extrude(Base=cull_i, Direction=Y_2)
rotax_2 = RotateAxis(Geometry=overhangs, Angle=rad_2, Axis=cull_i)  # -> Geometry, Transform

item_3 = ListItem(List=debrep.Faces, Index=Slider(6, range=1..6), Wrap=True)

# ----
# South Facade (Opaque)
# Wall Area
# (include window)
brep_2 = Brep(item_3)
debrep_2 = DeconstructBrep(Brep=brep_2)  # -> Faces, Edges, Vertices
debrep_3 = DeconstructBrep(Brep=southglazing)  # -> Faces, Edges, Vertices
crv = Curve(debrep_2.Edges)
crv_2 = Curve(debrep_3.Edges)
join_curves = JoinCurves(Curves=crv, Preserve=False)
join_curves_2 = JoinCurves(Curves=crv_2, Preserve=False)
region_difference = RegionDifference(CurvesA=join_curves, CurvesB=join_curves_2)
southopaque = BoundarySurfaces(Edges=region_difference)

# ---- group: Ceiling
# Geometry Modeling
number_slider_2 = Slider(5, range=1..6)
item_4 = ListItem(List=debrep.Faces, Index=number_slider_2, Wrap=True)

# ---- group: Floor
item_5 = ListItem(List=debrep.Faces, Index=Slider(4, range=1..6), Wrap=True)

# ---- group: West facade
item_6 = ListItem(List=debrep.Faces, Index=Slider(3, range=1..6), Wrap=True)

# ---- group: East facade
item_7 = ListItem(List=debrep.Faces, Index=Slider(1, range=1..6), Wrap=True)

# ---- group: North facade
item_8 = ListItem(List=debrep.Faces, Index=Slider(2, range=1..6), Wrap=True)

# ----
# Room:
# Geometry Output
wall_north = Geometry(item_8)
wall_west = Geometry(item_6)
wall_east = Geometry(item_7)
flip_2 = Flip(Surface=item_5)  # -> Surface, Result
wall_south = Geometry(southopaque)
brep_join = BrepJoin(Breps=[wall_west, wall_north, wall_east, wall_south])  # -> flatten(Breps), Closed

merge = Merge(Data1=rotax.Geometry, Data2=rotax_2.Geometry)  # -> flatten(Result)

# ----
# Ceiling
# Floor/Grid
# Wall
# Window
# Shadings
window = Geometry(flip.Surface)
floor = Geometry(flip_2.Surface)
wall = Geometry(brep_join.Breps)
# Geometry Outputs
ceiling = Geometry(item_4)
shading = Geometry(merge)

# ----
# Window-to-Floor Ratio
window_area = Area(Geometry=window)  # -> Area, Centroid
wall_area = Area(Geometry=floor)  # -> Area, Centroid
division_2 = Division(A=window_area.Area, B=wall_area.Area)
window_to_floor_ratio = Panel(division_2)

# ----
# Window Size
window_area_2 = Area(Geometry=window)  # -> Area, Centroid
window_size = Panel(window_area_2.Area)

# ----
# Numerical Outputs
# Window-to-Wall Ratio
window_area_3 = Area(Geometry=window)  # -> Area, Centroid
wall_area_2 = Area(Geometry=brep_2)  # -> Area, Centroid
division_3 = Division(A=window_area_3.Area, B=wall_area_2.Area)
window_to_wall_ratio = Panel(division_3)

# ----
# Total Shading Area
wall_area_3 = Area(Geometry=shading)  # -> Area, Centroid
mass_addition = MassAddition(Input=wall_area_3.Area)  # -> Result, PartialResults
total_shading_area = Panel(mass_addition.Result)

# ----
# Materials Setting (Window)
# Glazing Assembly
# Woven Shade
glazing_types = Slider(1, range=1..3)
transmittance = Panel("""N/A
50.6%
60.4%
69.6%""")
glazing_materials = Panel("""N/A
Optiblue - Solarban 60 (3) (Argon)
Solarban 60 (2) on Solexia - Clear (Argon)
Clear - Solarban 60 (3) (Argon)""")
item_9 = ListItem(List=glazing_materials, Index=glazing_types, Wrap=True)
item_10 = ListItem(List=transmittance, Index=glazing_types, Wrap=True)
glazing_materials_2 = Panel(item_9)
shade_position = ValueList({"Open": 0, "Closed": 1}, selected="Open")
transmittance_2 = Panel(item_10)
glazing = GetCSGlazingAssembly(Search=glazing_materials_2, UnitSystem=4)
shade = GetCSWovenShade(UnitSystem=4)

# ----
# Materials Setting
# Grey painted door dry riser
reflectance = ValueList({"20.00%": "floor lm83", "35.14%": "Grey painted door dry riser"}, selected="20.00%")
reflectance_2 = ValueList({"70.00%": "ceiling lm83", "90.56%": "bristol board"}, selected="70.00%")
panel = Panel("floor lm83")
panel_2 = Panel("ceiling lm83")
panel_3 = Panel("bristol board")
material = GetCSLightingMaterial(Search="ceiling lm83", UnitSystem=4)
material_2 = GetCSLightingMaterial(Search=reflectance, UnitSystem=4)
material_3 = GetCSLightingMaterial(Search=reflectance_2, UnitSystem=4)
material_4 = GetCSLightingMaterial(Search="ceiling lm83", UnitSystem=4)
material_5 = GetCSLightingMaterial(Search=glazing_materials_2, UnitSystem=4)

# ----
# Sensor Spacing (meters)
sensor_spacing = Slider(0.6096, range=0.5..1)

sensor_inset_meters_min = Slider(0, range=0..1)
sensor_inset_meters_target = Slider(0.3048, range=0..1)

# ----
# Samples per Sensor
sps = Slider(1600, range=400..6400)

# ----
# Room Orientation: 0=South, 90=West,
# 180=North, 270=East
north_offset = Slider(0, range=0..359.999)

scenelayer = ConstructCSSceneLayer(
    Name="Static Window",
    Material=material_5,
    Geometry=window,
    Input_0_Hidden=False,
    Input_0_Name="Name",
    Input_1_Hidden=False,
    Input_1_Name="Material",
    Input_2_Hidden=False,
    Input_2_Name="Geometry",
    Input_3_Hidden=True,
    Input_3_Name="ViewTag",
    UnitSystem=4,
    Input_3_GHParam_Branch0_Path="{0}",
    Input_3_GHParam_Branch0_Item0_null_string=False,
    Input_3_GHParam_Branch0_Item0_string="None")

# ---- group: Fin_
ln_7 = Line(StartPoint=pt_topright, EndPoint=pt_topleft)
window_width = Length(Curve=ln_7)

# ---- group: Overhang_
# Shading Factors, View Angles
# shading factor= Depth of overhang/the portion of window height
ln_8 = Line(StartPoint=pt_topright, EndPoint=pt_bottomright)
window_height = Length(Curve=ln_8)

# ---- group: Fin_
sin = Sine(Value=rad)
b = Number(sin)

cos = Cosine(Value=rad)
a = Number(cos)

# ---- group: Overhang_
cos_2 = Cosine(Value=rad_2)
a_2 = Number(cos_2)

sin_2 = Sine(Value=rad_2)
b_2 = Number(sin_2)

# ----
button = Button()

# ---- group: Fin_ / win-width
W = Number(window_width)

# ---- group: Fin_ / fin-depth
D = Number(fin_depth)

# ---- group: Fin_ / fins number
j = Number(total_fins)

# ----
toggle = BooleanToggle(False)
weather_file_mt = FilePath("C:\Users\manal2\Downloads\USA_MT_Bozeman-Gallatin.Field.726797_TMY3.epw")

# ---- group: Overhang_ / Win-Height
H = Number(window_height)

# ----
weather_file_va = FilePath("C:\DIVA\WeatherData\USA_VA_Sterling-Washington.Dulles.Intl.AP.724030_TMY3.epw")

# ----
# Climate Studio Module
# Surfaces added to the Window component
# should not also be added to SceneLayers.
# LEED standard selection
radiance_params = ValueList({"-ab 3 -lw 0.01", "-ab 4 -lw 0.01", "-ab 5 -lw 0.01", "-ab 6 -lw 0.01", "-ab 7 -lw 0.01", "-ab 8 -lw 0.01", "-ab 9 -lw 0.01"}, selected="-ab 6 -lw 0.01")
workplane_offset_meters = Slider(0.762, range=0..5)
scenelayer_2 = ConstructCSSceneLayer(
    Name="WALL",
    Material=material_4,
    Geometry=wall,
    Input_0_Hidden=False,
    Input_0_Name="Name",
    Input_1_Hidden=False,
    Input_1_Name="Material",
    Input_2_Hidden=False,
    Input_2_Name="Geometry",
    Input_3_Hidden=True,
    Input_3_Name="ViewTag",
    UnitSystem=4,
    Input_3_GHParam_Branch0_Path="{0}",
    Input_3_GHParam_Branch0_Item0_null_string=False,
    Input_3_GHParam_Branch0_Item0_string="None")
scenelayer_3 = ConstructCSSceneLayer(
    Name="CEILING",
    Material=material,
    Geometry=ceiling,
    Input_0_Hidden=False,
    Input_0_Name="Name",
    Input_1_Hidden=False,
    Input_1_Name="Material",
    Input_2_Hidden=False,
    Input_2_Name="Geometry",
    Input_3_Hidden=True,
    Input_3_Name="ViewTag",
    UnitSystem=4,
    Input_3_GHParam_Branch0_Path="{0}",
    Input_3_GHParam_Branch0_Item0_null_string=False,
    Input_3_GHParam_Branch0_Item0_string="None")
scenelayer_4 = ConstructCSSceneLayer(
    Name="FLOOR",
    Material=material_2,
    Geometry=floor,
    Input_0_Hidden=False,
    Input_0_Name="Name",
    Input_1_Hidden=False,
    Input_1_Name="Material",
    Input_2_Hidden=False,
    Input_2_Name="Geometry",
    Input_3_Hidden=True,
    Input_3_Name="ViewTag",
    UnitSystem=4,
    Input_3_GHParam_Branch0_Path="{0}",
    Input_3_GHParam_Branch0_Item0_null_string=False,
    Input_3_GHParam_Branch0_Item0_string="None")
scenelayer_5 = ConstructCSSceneLayer(
    Name="SHADING",
    Material=material_3,
    Geometry=shading,
    Input_0_Hidden=False,
    Input_0_Name="Name",
    Input_1_Hidden=False,
    Input_1_Name="Material",
    Input_2_Hidden=False,
    Input_2_Name="Geometry",
    Input_3_Hidden=True,
    Input_3_Name="ViewTag",
    UnitSystem=4,
    Input_3_GHParam_Branch0_Path="{0}",
    Input_3_GHParam_Branch0_Item0_null_string=False,
    Input_3_GHParam_Branch0_Item0_string="None")
grid = ConstructCSSensorGrid(
    Level="LEVEL 01",
    Id="101",
    Description="Office",
    Geometry=floor,
    Spacing=sensor_spacing,
    TargetInset=sensor_inset_meters_target,
    MinInset=sensor_inset_meters_min,
    WorkOffset=workplane_offset_meters,
    Input_0_Hidden=True,
    Input_0_Name="Building",
    Input_10_Hidden=True,
    Input_10_Name="SupplementalLux",
    Input_11_Hidden=True,
    Input_11_Name="TargetLux",
    Input_12_Hidden=True,
    Input_12_Name="ExcessiveLux",
    Input_13_Hidden=True,
    Input_13_Name="sDA_Time",
    Input_14_Hidden=True,
    Input_14_Name="BREEAMSpaceType",
    Input_15_Hidden=True,
    Input_15_Name="ViewOffset",
    Input_16_Hidden=True,
    Input_16_Name="ViewDirections",
    Input_17_Hidden=True,
    Input_17_Name="ViewRotation",
    Input_18_Hidden=True,
    Input_18_Name="Points Override",
    Input_19_Hidden=True,
    Input_19_Name="Normals Override",
    Input_1_Hidden=False,
    Input_1_Name="Level",
    Input_20_Hidden=True,
    Input_20_Name="Disk Radius",
    Input_21_Hidden=True,
    Input_21_Name="Normal Override",
    Input_2_Hidden=False,
    Input_2_Name="Id"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)
window_2 = ConstructCSWindow(
    Glazing=glazing,
    WovenShade=shade,
    Surface=window,
    Input_0_Hidden=False,
    Input_0_Name="Glazing",
    Input_1_Hidden=False,
    Input_1_Name="WovenShade",
    Input_2_Hidden=False,
    Input_2_Name="Position",
    Input_3_Hidden=True,
    Input_3_Name="Rotation",
    Input_4_Hidden=False,
    Input_4_Name="Position Schedule",
    Input_5_Hidden=True,
    Input_5_Name="Rotation Schedule",
    Input_6_Hidden=True,
    Input_6_Name="ECGlass",
    Input_7_Hidden=True,
    Input_7_Name="Tint",
    Input_8_Hidden=True,
    Input_8_Name="Tint Schedule",
    Input_9_Hidden=False,
    Input_9_Name="Surface",
    Mode=0,
    UnitSystem=4)
data = Data(flatten([scenelayer_3, scenelayer_4, scenelayer_2, scenelayer_5, scenelayer]))
daylightmodel = ConstructCSDaylightModel(
    SceneLayers=data,
    SensorGrids=grid,
    NorthOffset=north_offset,
    Input_0_Hidden=False,
    Input_0_Name="SceneLayers",
    Input_1_Hidden=False,
    Input_1_Name="Windows",
    Input_2_Hidden=False,
    Input_2_Name="Luminaires",
    Input_3_Hidden=True,
    Input_3_Name="Tubular Devices",
    Input_4_Hidden=False,
    Input_4_Name="SensorGrids",
    Input_5_Hidden=False,
    Input_5_Name="Camera",
    Input_6_Hidden=False,
    Input_6_Name="North Offset",
    UnitSystem=4)
daylight = RunCSDaylight(
    Name="Simple Office\LEED Daylight",
    Model=daylightmodel,
    WeatherFile=weather_file_va,
    Samples=sps,
    SaveHourly=False,
    RadianceParams=radiance_params,
    Run=toggle,
    Input_0_Hidden=False,
    Input_0_Name="Name",
    Input_10_Hidden=False,
    Input_10_Name="Run",
    Input_1_Hidden=False,
    Input_1_Name="Model",
    Input_2_Hidden=True,
    Input_2_Name="BldgType",
    Input_3_Hidden=False,
    Input_3_Name="WeatherFile",
    Input_4_Hidden=True,
    Input_4_Name="Ground Albedo",
    Input_5_Hidden=False,
    Input_5_Name="Samples",
    Input_6_Hidden=False,
    Input_6_Name="Save Hourly",
    Input_7_Hidden=True,
    Input_7_Name="Threads",
    Input_8_Hidden=True,
    Input_8_Name="Hide Pop-up",
    Input_9_Hidden=False,
    Input_9_Name="Radiance Params",
    Standard=0,
    UnitSystem=4,
    Input_2_GHParam_Branch0_Path="{0}",
    Input_2_GHParam_Branch0_Item0_null_string=False,
    Input_2_GHParam_Branch0_Item0_string="Office",
    Input_4_GHParam_Branch0_Path="{0}",
    Input_4_GHParam_Branch0_Item0_number=0.2,
    Input_7_GHParam_Branch0_Path="{0}",
    Input_7_GHParam_Branch0_Item0_number=0,
    Input_8_GHParam_Branch0_Path="{0}",
    Input_8_GHParam_Branch0_Item0_boolean=False)
csr = LoadCSResult(
    Result=daylight,
    Header=False,
    Output_0_Hidden=False,
    Output_0_Name="Name",
    Output_10_Hidden=True,
    Output_10_Name="Weather",
    Output_11_Hidden=True,
    Output_11_Name="North",
    Output_12_Hidden=True,
    Output_12_Name="LayerNames",
    Output_13_Hidden=True,
    Output_13_Name="LayerObjects",
    Output_14_Hidden=True,
    Output_14_Name="LayerMaterials",
    Output_15_Hidden=True,
    Output_15_Name="Sky",
    Output_1_Hidden=False,
    Output_1_Name="Type",
    Output_2_Hidden=True,
    Output_2_Name="Standard",
    Output_3_Hidden=True,
    Output_3_Name="Date",
    Output_4_Hidden=True,
    Output_4_Name="Version",
    Output_5_Hidden=True,
    Output_5_Name="FileSize",
    Output_6_Hidden=True,
    Output_6_Name="RunLog",
    Output_7_Hidden=False,
    Output_7_Name="Metrics",
    Output_8_Hidden=False,
    Output_8_Name="MetricValues",
    Output_9_Hidden=False,
    Output_9_Name="Grids",
    UnitSystem=4)  # -> Name, Type, Metrics, MetricValues, Grids
previewgrid = PreviewCSSensorGrid(
    Grid=csr.Grids,
    Metric="UDI (all bins) (SensorArray) [fraction of time]",
    Input_0_Hidden=False,
    Input_0_Name="Grid",
    Input_1_Hidden=False,
    Input_1_Name="Metric",
    Input_2_Hidden=True,
    Input_2_Name="Falsecolor",
    Input_3_Hidden=True,
    Input_3_Name="Sensor Values",
    Input_4_Hidden=True,
    Input_4_Name="Show Points",
    Input_5_Hidden=True,
    Input_5_Name="Show Edges",
    Input_6_Hidden=True,
    Input_6_Name="Show Labels",
    Input_7_Hidden=True,
    Input_7_Name="Label Format",
    Input_8_Hidden=True,
    Input_8_Name="Transform",
    Output_0_Hidden=True,
    Output_0_Name="Mesh",
    Output_1_Hidden=True,
    Output_1_Name="Texture",
    UnitSystem=4,
    Input_4_GHParam_Branch0_Path="{0}",
    Input_4_GHParam_Branch0_Item0_boolean=True,
    Input_5_GHParam_Branch0_Path="{0}",
    Input_5_GHParam_Branch0_Item0_boolean=True,
    Input_6_GHParam_Branch0_Path="{0}",
    Input_6_GHParam_Branch0_Item0_boolean=False)
lng = ListLength(List=csr.Metrics)
dup = DuplicateData(Data="************************", Number=lng, Order=True)
weave = Weave(Pattern=[0, 1, 2], Stream0=dup, Stream1=csr.Metrics, Stream2=csr.MetricValues, NullGaps=False)

# ----
# Whole building UDI metrics
degrid = DeconstructCSSensorGrid(
    Grid=csr.Grids,
    Output_0_Hidden=False,
    Output_0_Name="Building",
    Output_10_Hidden=True,
    Output_10_Name="Edges",
    Output_11_Hidden=True,
    Output_11_Name="View Points",
    Output_12_Hidden=True,
    Output_12_Name="Area",
    Output_13_Hidden=True,
    Output_13_Name="View Directions",
    Output_14_Hidden=False,
    Output_14_Name="Occupancy",
    Output_15_Hidden=True,
    Output_15_Name="View Wedges",
    Output_16_Hidden=True,
    Output_16_Name="Supplemental Lux",
    Output_17_Hidden=True,
    Output_17_Name="Target Lux",
    Output_18_Hidden=True,
    Output_18_Name="Excessive Lux",
    Output_19_Hidden=True,
    Output_19_Name="Normal Override",
    Output_1_Hidden=False,
    Output_1_Name="Level",
    Output_20_Hidden=True,
    Output_20_Name="Use Normal Override",
    Output_21_Hidden=False,
    Output_21_Name="Metrics",
    Output_22_Hidden=False,
    Output_22_Name="Values"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)  # -> Building, Level, ID, SensorPoints, WindowGroups, Occupancy, Metrics, Values
split = SplitTree(Data=degrid.Values, Masks=flatten("{*;12}"))  # -> flatten(Positive), Negative
split_2 = SplitTree(Data=degrid.Values, Masks=flatten("{*;13}"))  # -> flatten(Positive), flatten(Negative)
split_3 = SplitTree(Data=degrid.Values, Masks=flatten("{*;14}"))  # -> flatten(Positive), flatten(Negative)
split_4 = SplitTree(Data=degrid.Values, Masks=flatten("{*;15}"))  # -> flatten(Positive), flatten(Negative)
avr = Average(Input=split.Positive)
avr_2 = Average(Input=split_2.Positive)
avr_3 = Average(Input=split_3.Positive)
avr_4 = Average(Input=split_4.Positive)
udia_bldg_mean = Panel(avr_3)
udie_bldg_mean = Panel(avr_4)
udif_bldg_mean = Panel(avr)
udis_bldg_mean = Panel(avr_2)
ma = MassAddition(Input=[udif_bldg_mean, udis_bldg_mean, udia_bldg_mean, udie_bldg_mean])  # -> Result, PartialResults
panel_4 = Panel(ma.Result)
panel_5 = Panel(degrid.Metrics)

weather_file_tx = FilePath("C:\DIVA\WeatherData\USA_TX_Houston-Bush.Intercontinental.AP.722430_TMY3.epw")

# ---- group: Overhang_ / overhang-depth
D_2 = Number(overhang_depth)

# ---- group: Overhang_ / Overhang number
k = Number(total_overhangs)

# ----
weather_file_fl = FilePath("C:\Users\manal2\Downloads\USA_FL_Miami.Intl.AP.722020_TMY3.epw")

# ---- group: Shading factor_Fins_Right
expression = Expression(W=W, D=D, j=j, a=a, b=b, Expression="D*a/(W/(j-1) + D*b)")
fins_right = Panel(expression)

# ---- group: Shading factor_Fins_Left
expression_2 = Expression(W=W, D=D, j=j, a=a, b=b, Expression="D*a/(W/(j-1) - D*b)")
fins_left = Panel(expression_2)

# ---- group: shading factor_overhang_Up
expression_3 = Expression(H=H, D=D_2, a=a_2, b=b_2, k=k, Expression="D*a/(H/k + D*b)")
up = Panel(expression_3)

# ---- group: shading factor_overhang_Down
expression_4 = Expression(H=H, D=D_2, a=a_2, b=b_2, k=k, Expression="D*a/(H/k - D*b)")

# ----
glare = RunCSAnnualGlare(
    Name="Simple Office\Annual Glare",
    Model=daylightmodel,
    WeatherFile=weather_file_va,
    Samples=sps,
    SaveHourly=False,
    RadianceParams=radiance_params,
    Run=toggle,
    Input_0_Hidden=False,
    Input_0_Name="Name",
    Input_1_Hidden=False,
    Input_1_Name="Model",
    Input_2_Hidden=False,
    Input_2_Name="WeatherFile",
    Input_3_Hidden=False,
    Input_3_Name="Samples",
    Input_4_Hidden=False,
    Input_4_Name="Save Hourly",
    Input_5_Hidden=True,
    Input_5_Name="Threads",
    Input_6_Hidden=True,
    Input_6_Name="Hide Pop-up",
    Input_7_Hidden=False,
    Input_7_Name="Radiance Params",
    Input_8_Hidden=False,
    Input_8_Name="Run",
    UnitSystem=4,
    Input_5_GHParam_Branch0_Path="{0}",
    Input_5_GHParam_Branch0_Item0_number=0)
csr_2 = LoadCSResult(
    Result=glare,
    Header=False,
    Output_0_Hidden=False,
    Output_0_Name="Name",
    Output_10_Hidden=True,
    Output_10_Name="Weather",
    Output_11_Hidden=True,
    Output_11_Name="North",
    Output_12_Hidden=True,
    Output_12_Name="LayerNames",
    Output_13_Hidden=True,
    Output_13_Name="LayerObjects",
    Output_14_Hidden=True,
    Output_14_Name="LayerMaterials",
    Output_15_Hidden=True,
    Output_15_Name="Sky",
    Output_1_Hidden=False,
    Output_1_Name="Type",
    Output_2_Hidden=True,
    Output_2_Name="Standard",
    Output_3_Hidden=True,
    Output_3_Name="Date",
    Output_4_Hidden=True,
    Output_4_Name="Version",
    Output_5_Hidden=True,
    Output_5_Name="FileSize",
    Output_6_Hidden=True,
    Output_6_Name="RunLog",
    Output_7_Hidden=False,
    Output_7_Name="Metrics",
    Output_8_Hidden=False,
    Output_8_Name="MetricValues",
    Output_9_Hidden=False,
    Output_9_Name="Grids",
    UnitSystem=4)  # -> Name, Type, Metrics, MetricValues, Grids
lng_2 = ListLength(List=csr_2.Metrics)
previewgrid_2 = PreviewCSSensorGrid(
    Grid=csr_2.Grids,
    Input_0_Hidden=False,
    Input_0_Name="Grid",
    Input_1_Hidden=False,
    Input_1_Name="Metric",
    Input_2_Hidden=True,
    Input_2_Name="Falsecolor",
    Input_3_Hidden=True,
    Input_3_Name="Sensor Values",
    Input_4_Hidden=True,
    Input_4_Name="Show Points",
    Input_5_Hidden=True,
    Input_5_Name="Show Edges",
    Input_6_Hidden=True,
    Input_6_Name="Show Labels",
    Input_7_Hidden=True,
    Input_7_Name="Label Format",
    Input_8_Hidden=True,
    Input_8_Name="Transform",
    Output_0_Hidden=True,
    Output_0_Name="Mesh",
    Output_1_Hidden=True,
    Output_1_Name="Texture",
    UnitSystem=4,
    Input_4_GHParam_Branch0_Path="{0}",
    Input_4_GHParam_Branch0_Item0_boolean=True,
    Input_5_GHParam_Branch0_Path="{0}",
    Input_5_GHParam_Branch0_Item0_boolean=True,
    Input_6_GHParam_Branch0_Path="{0}",
    Input_6_GHParam_Branch0_Item0_boolean=False)
dup_2 = DuplicateData(Data="************************", Number=lng_2, Order=True)
item_11 = ListItem(List=csr.MetricValues, Index=1, Wrap=True)
item_12 = ListItem(List=csr.MetricValues, Index=2, Wrap=True)

# ---- group: View angle_right
expression_5 = Expression(W=W, D=D, a=a, b=b, j=j, Expression="(W/(j-1)-D*b)/(D*a)")
atan = ArcTangent(Value=expression_5)
deg = Degrees(Radians=atan)
addition_4 = Addition(A=deg, B=fins_rotation_angle)
view_angle = Panel(addition_4)

# ---- group: View angle_overhang_Up
expression_6 = Expression(H=H, D=D_2, a=a_2, b=b_2, k=k, Expression="(H/k + D*b)/(D*a)")
atan_2 = ArcTangent(Value=expression_6)
deg_2 = Degrees(Radians=atan_2)
subtraction_6 = Subtraction(A=deg_2, B=overhang_rotation_angle)

# ---- group: View angle_left
expression_7 = Expression(W=W, D=D, a=a, b=b, j=j, Expression="(W/(j-1)-D*b)/(D*a)")
atan_3 = ArcTangent(Value=expression_7)
deg_3 = Degrees(Radians=atan_3)
subtraction_7 = Subtraction(A=deg_3, B=fins_rotation_angle)

# ---- group: View angle_overhang_Down
expression_8 = Expression(H=H, D=D_2, a=a_2, b=b_2, k=k, Expression="(H/k - D*b)/(D*a)")
atan_4 = ArcTangent(Value=expression_8)
deg_4 = Degrees(Radians=atan_4)
addition_5 = Addition(A=deg_4, B=overhang_rotation_angle)

# ----
weave_2 = Weave(Pattern=[0, 1, 2], Stream0=dup_2, Stream1=csr_2.Metrics, Stream2=csr_2.MetricValues, NullGaps=False)
metrics = Panel(weave_2)

# ----
# sDA, ASE RESULT
metrics_2 = Panel(weave)

# ----
# If you want to export images,
# please delete this panel.
number_slider_3 = Slider(5, range=1..12)
number_slider_4 = Slider(2, range=1..12)
# Data
# Autorun
# and Record
number_slider_5 = Slider(1, range=1..12)
item_13 = ListItem(List=csr.Metrics, Index=number_slider_5, Wrap=True)
item_14 = ListItem(List=csr.MetricValues, Index=number_slider_4, Wrap=True)
item_15 = ListItem(List=csr.MetricValues, Index=number_slider_5, Wrap=True)
item_16 = ListItem(List=csr.Metrics, Index=number_slider_4, Wrap=True)
item_17 = ListItem(List=csr.Metrics, Index=number_slider_3, Wrap=True)
item_18 = ListItem(List=csr.MetricValues, Index=number_slider_3, Wrap=True)
sda = Panel(item_13)
ase = Panel(item_16)
ase_result = Panel(item_14)
udi = Panel(item_17)
udi_result = Panel(item_18)
sda_result = Panel(item_15)
cancel_image_export = Panel("N/A")
image_setting = ImageSetting(ImageSaveAsName="defaultName", RhinoViewNames=cancel_image_export, Width=600, Height=600)

# ----
# LEED 4 Credits
ase_limitation = Panel("0.1")
ase_2 = Panel(ase_result)
sda_limitation = Panel("0.75")
sda_2 = Panel(sda_result)
replace_as_n_a = Panel("N/A")
find_0 = Panel("0")
expression_9 = Expression(A=sda_2, B=ase_2, x=sda_limitation, y=ase_limitation, Expression="if(A≥x,4,0) and if(B≤y,4,0)")
replace_text = ReplaceText(Text=expression_9, Find=find_0, Replace=replace_as_n_a, RecursiveReplace=False)
leed_credits = Panel(replace_text)

sda_3 = Number(item_11)
ase_3 = Number(item_12)
galapagos = Galapagos(
    fitness=num,
    gene=[window_width_ft, window_height_ft, total_fins, fin_depth, overhang_depth, total_overhangs, north_offset])

# ----
# 3. set as "True"
toggle_2 = BooleanToggle(False)

number_slider_6 = Slider(0, range=0..1)
number_slider_7 = Slider(0, range=0..1)

# ----
# Export to csv file
_100 = Panel("100")
multiplication = Multiplication(A=sda_result, B=_100)
multiplication_2 = Multiplication(A=ase_result, B=_100)
multiplication_3 = Multiplication(A=udi_result, B=_100)
multiplication_4 = Multiplication(A=udia_bldg_mean, B=_100)
multiplication_5 = Multiplication(A=udif_bldg_mean, B=_100)
multiplication_6 = Multiplication(A=udie_bldg_mean, B=_100)
# Script optimization
sda_result_2 = Panel(multiplication)
udie_result = Panel(multiplication_6)
ase_result_2 = Panel(multiplication_2)
udia_result = Panel(multiplication_4)
udi_result_2 = Panel(multiplication_3)
udif_result = Panel(multiplication_5)

python = GhPythonScript(sda=sda_3, ase=ase_3)  # -> out, a
# ---------- python: Python ----------
__author__ = "prema"
__version__ = "2022.08.21"

import rhinoscriptsyntax as rs

def _sda(x):
    if x <= 75:
        return 0.0177 * (x ** 2)
    else:
        return 100

def _ase(x):
    if x <= 9:
        return 100
    elif x <= 20:
        return 103 - 0.4 * x
    else:
        return -0.000186 * (x - 100) ** 3

#Maximize the objective
sda, ase = map(lambda x: float(x) * 100, [sda, ase])
print(sda,ase)
if sda>= 75 and ase <= 10:
    print(-1 * (1 - (_sda(sda) * _ase(ase)) / 10000.0) + (sda - ase) / 100)
else:
    print(-1 * (1 - (_sda(sda) * _ase(ase)) / 10000.0))
# ---------- end python ----------
item_19 = ListItem(List=python.out, Index=1, Wrap=True)

# ----
# 2. Set normal state as True,
# and after finishing step 4,
# set it as False.
# Simulation Run
run = Button(ExpressionNormal="true")

num = Number(item_19)
item_20 = ListItem(List=csr_2.Metrics, Index=0, Wrap=True)
item_21 = ListItem(List=csr_2.MetricValues, Index=0, Wrap=True)
panel_6 = Panel(python.out)
glare_2 = Panel(item_21)

# ----
# 4. Click Fly
iterator = ColibriIterator(
    Fin_Depth=fin_depth,
    Overhang_Depth=overhang_depth,
    Total_Fins=total_fins,
    Total_Overhangs=total_overhangs,
    Overhang_Rotation_Angle=overhang_rotation_angle,
    Fins_Rotation_Angle=fins_rotation_angle,
    Glazing_types=glazing_types,
    Window_width_ft=window_width_ft,
    Window_height_ft=window_height_ft,
    north_offset=north_offset,
    RemoteFly=False,
    ignoreAllWarningMsg=False)  # -> Fin_Depth, Overhang_Depth, Total_Fins, Total_Overhangs, Overhang_Rotation_Angle, Fins_Rotation_Angle, Glazing_types, Window_width_ft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
parameters = ColibriParameters(
    sDA=flatten(item_15),
    ASE=flatten(item_14),
    UDI=flatten(item_18),
    PF_overhang=flatten(expression_3),
    PF_fins=flatten(expression),
    View_angle_overhang=flatten(deg_2),
    View_angle_fin=flatten(deg),
    WWR=flatten(window_to_wall_ratio),
    Glare=flatten(glare_2),
    Transmittance=flatten(transmittance_2),
    WFR=flatten(window_to_floor_ratio),
    Total_Shading_Area=flatten(total_shading_area),
    Window_Size=flatten(window_size),
    LEED_Credits=flatten(leed_credits),
    UDIf_Bldg_Mean=flatten(udif_bldg_mean),
    UDIa_Bldg_Mean=flatten(udia_bldg_mean),
    UDIs_Bldg_Mean=flatten(udis_bldg_mean),
    UDIe_Bldg_Mean=flatten(udie_bldg_mean),
    north_offset=flatten(north_offset),
    Room_Width_ft=flatten(room_width_ft),
    Room_Depth_ft=flatten(room_depth_ft),
    Room_Height_ft=flatten(room_height_ft),
    Window_width_ft=flatten(window_width_ft),
    Window_height_ft=flatten(window_height_ft),
    Sill_height_3ft=flatten(sill_height_3ft),
    Fin_Depth=flatten(fin_depth),
    Overhang_Depth=flatten(overhang_depth),
    Total_Fins=flatten(total_fins),
    Total_Overhangs=flatten(total_overhangs),
    Location=flatten(location))

glare_3 = Panel(item_20)

panel_7 = Panel("""numpy
scipy
cma
random""")
pythonremote = GHPythonRemote(location="C:\Users\prema\.conda\envs\python2\python.exe", run=Toggle(False), modules=panel_7)  # -> out, linked_modules, rpy, import_statements
panel_8 = Panel(pythonremote.out)

panel_9 = Panel("C:\Users\manal2\Documents\Fall 2022\Lighting optimization\light_opt.log")
python_2 = GhPythonScript(x=Toggle(False), logger_filename=panel_9)  # -> out, a
# ---------- python_2: Python ----------
__author__ = "Summation"
__version__ = "2020.05.15"

import rhinoscriptsyntax as rs
import Grasshopper as gh
import scriptcontext as sc
import ghpythonremote


def reset():
    cma = sc.sticky['cma']
    rpy = sc.sticky['rpy']
    random = sc.sticky['random']
    sc.sticky["input"] = {}
    #params = ['Room_Width', 'Room_Depth', 'Room_Height', 'Window-height(ft)',\
    #    'Window-width(ft)', 'Total Fins', 'Total Overhangs', 'Overhang_Depth',\
    #    'Overhang_Rotation_down_deg', 'Fin_Depth', 'Fins_Rotation_north_deg']
    seq_params = []
    std = {'Window-height(ft)' : 2,\
        'Window-width(ft)' : 2, 'Overhang_Depth' : 2, 'Fin_Depth': 2,
        'Total_Overhangs': 2, 'Total_Fins': 2, 'north_offset':240}
    discrete = set(['Total_Overhangs', 'Total_Fins'])
        #'Overhang_Rotation_down_deg': 5,  'Fins_Rotation_north_deg': 5}
    
    params = list(std.keys())
    stds = []
    ghObjects = ghenv.Component.OnPingDocument().Objects
    initial_vals = []
    bounds = [[],[]]
    # Iterate the GH objects
    for obj in ghObjects:
        if obj.NickName != '':
            if type(obj) is gh.Kernel.Special.GH_NumberSlider and obj.NickName in params:
                sc.sticky["input"][obj.NickName] = (obj, obj.Slider.Minimum, obj.Slider.Maximum)
                # Set min/max
                #obj.Slider.Minimum = 0
                #obj.Slider.Maximum = 1
                initial_vals.append(random.randint(int(obj.Slider.Minimum), int(obj.Slider.Maximum)))
                #initial_vals.append((obj.Slider.Minimum + obj.Slider.Maximum) / 2.0)
                stds.append(std[obj.NickName])
                seq_params.append(obj.NickName)
                # Set value
                obj.Slider.Value = initial_vals[-1]
                bounds[0].append(int(obj.Slider.Minimum))
                bounds[1].append(int(obj.Slider.Maximum))
                # Update slider
                obj.ExpireSolution(True)
    #print(bounds)
    di = {'bounds':bounds, "CMA_stds":stds}
    print(di)
    di = ghpythonremote.deliver(rpy, di)
    es = cma.CMAEvolutionStrategy(initial_vals,0.5, di)
    sc.sticky['optimizer'] = es
    sc.sticky['pending'] = es.ask()
    sc.sticky['evals'] = {}
    sc.sticky['iterator'] = 0
    sc.sticky['evaluations'] = []
    sc.sticky['prev_input'] = tuple(initial_vals)
    sc.sticky['params'] = seq_params
    sc.sticky['logger_filename'] = logger_filename
    sc.sticky['stop'] = False
    sc.sticky['discrete'] = discrete
    sc.sticky['best_f_val'] = float("inf")
    sc.sticky['best_x'] = None
    lf = open(logger_filename, 'w')
    lf.write("STARTED\n")
    lf.close()
    
    print len(sc.sticky['pending']), len(sc.sticky['prev_input'])

#print(sc.sticky['input'])
if not x:
    reset()
    print(sc.sticky)
else:
    print("Running..")
a = x
# ---------- end python_2 ----------
panel_10 = Panel("C:\Users\manal2\Documents\Fall 2022\Lighting optimization\cma_model")
python_3 = GhPythonScript(
    save_path=panel_10,
    SDA=sda_result_2,
    ASE=ase_result_2,
    WWR=window_to_wall_ratio,
    Shading=total_shading_area,
    Glare=glare_2,
    run=python_2.a,
    window_size=window_size,
    window_height=window_height_ft,
    window_width=window_width_ft,
    room_height=room_height_ft,
    room_width=room_width_ft,
    UDI=udi_result_2,
    UDIF=udif_result,
    UDIA=udia_result,
    UDIE=udie_result,
    north_offset=north_offset)  # -> out, Genome
# ---------- python_3: Python ----------
__author__ = "Summation"
__version__ = "2020.03.17"

import rhinoscriptsyntax as rs
import scriptcontext as sc

import math
import Grasshopper as gh

globals = sc.sticky

def updateSliders(sliders):
    print(sliders)
    for param in globals['input'].keys():
        obj = globals['input'][param][0]
        obj.Slider.Value = sliders[obj.NickName]
        obj.ExpireSolution(True)


def getGenome():
    val = []
    for x in range(len(globals['params'])):
        ans = '['
        ans += globals['params'][x] + ','
        #print(globals['params'][x],globals['discrete'])

        if globals['params'][x] == "Total_Fins":
            if globals['prev_input'][x] >= 1 and globals['prev_input'][x] < 2:
                ans += str(2) #round(next_inp[x])
            elif globals['prev_input'][x] >= 0 and globals['prev_input'][x] < 1:
                ans += '0'
            else:
                ans += str(round(globals['prev_input'][x]))
        elif globals['params'][x] in globals['discrete']:
            ans += str(round(globals['prev_input'][x]))
        else:
            ans += str(round(globals['prev_input'][x], 3))
        ans+= ']'
        val.append(ans)
    
    return val

def _sda(x):
    if x <= 75:
        return 0.0177 * (x ** 2)
    else:
        return 100

def _ase(x):
    if x <= 9:
        return 100
    elif x <= 20:
        return 103 - 0.4 * x
    else:
        return -0.000186 * (x - 100) ** 3

def apply_input(input):
    slider_param = {}
    for x in range(len(next_inp)):
        if globals['params'][x] not in globals['discrete']:
            slider_param[globals['params'][x]] = float(next_inp[x])
        elif globals['params'][x] == "Total_Fins":
            if next_inp[x] >= 1 and next_inp[x] < 2:
                slider_param[globals['params'][x]] = 2 #round(next_inp[x])
            elif next_inp[x] >= 0 and next_inp[x] < 1:
                slider_param[globals['params'][x]] = 0
            else:
                slider_param[globals['params'][x]] = round(next_inp[x])
        else:
            slider_param[globals['params'][x]] = round(next_inp[x])

    globals['prev_input'] = tuple(next_inp)

    return slider_param

def constraint(lhs, rhs):
    """
    Constraints of the form lhs < rhs
    Adds a background.
    """
    return lhs - rhs if rhs < lhs else 0

def eval_fun(sda,ase, wwr, shading, glare, window_size, udi, udif, udia, udie, wh, ww, rh, rw):
    #return 1000000 * (1 - (_sda(sda) * _ase(ase) / 10000.0)) + 0.0008 * shading + 0.04 * glare + 0.0001 * window_size + 0.006 * (100 - udi) + 0.065 * udif + 100 * constraint(wh + 2, rh) + 100 * constraint(ww, rw)# + 0.2 * wwr DON'T DELETE THIS
    #return 1000000 * (1 - (_sda(sda) * _ase(ase) / 10000.0)) + 0.0008 * shading + 0.0001 * window_size + 1000000 * constraint(wh + 3, rh) + 1000 * constraint(ww, rw)# + 0.2 * wwr DON'T DELETE THIS
    return 100000000 * (1 - (_sda(sda) * _ase(ase) / 10000.0))# + 0.0008 * shading + 1000000 * constraint(wh + 3, rh) + 1000 * constraint(ww, rw)
    #return 10 * (1000000 * (1 - (_sda(sda) * _ase(ase) / 10000.0)) + 0.006 * (100 - udi) + 0.065 * udif + 100 * constraint(wh + 2, rh) + 100 * constraint(ww, rw))# + 0.2 * wwr

def eval(x):
    # a wrapper aroudn eval_fun
    return eval_fun(x[0],x[1],x[2],x[3],x[4])

if run and (not globals['optimizer'].stop()) and SDA is not None:
    logger_filename = globals['logger_filename']
    if Shading is None:
        Shading = 0
    SDA, ASE, WWR, Shading, Glare, Window_size, udi, udif, udia, udie, wh, ww, rh, rw = map(float, [SDA, ASE, WWR, Shading, Glare, window_size, UDI, UDIF, UDIA, UDIE, window_height, window_width, room_height, room_width])
    value = eval_fun(SDA, ASE, WWR, Shading, Glare, Window_size, udi, udif, udia, udie, wh, ww, rh, rw)
    globals['evaluations'].append((globals['prev_input'], value))
    globals['iterator'] += 1
    s = "iterator " + str(globals['iterator']) + ": SDA: " + str(SDA) +' ASE: ' + str(ASE) + ' Window Size: ' + str(Window_size) + ' Shading: ' + str(Shading) + ' Glare1: ' + str(Glare) + ' UDI: ' + str(udi) + ' udif: ' + str(udif) +  ' udia: ' + str(udia) + 'udie:' + str(udie) + ' Eval_fn: ' + str(value) +'\n'
    lf = open(logger_filename, 'a')
    lf.write(s)
    s = " Pending for current Generation: " + str(len(globals['pending']))
    lf.write(s + '\n')
    lf.close()

    #set proper inputs here!
    globals['evals'][globals['prev_input']] = value
    if value < globals['best_f_val']:
        globals['best_f_val'] = value
        globals['best_x'] = globals['prev_input']
    print(globals['iterator'], globals['optimizer'].stop())
    if len(globals['pending']) == 0:
        globals['optimizer'].tell(globals['evals'].keys(), globals['evals'].values())
        globals['pending'] = globals['optimizer'].ask()
        #globals['optimizer'].objective_function = eval
        #s = globals['optimizer'].pickle_dumps()
        #open(save_path + "_" + str(globals['iterator']) + '.pkl', 'wb').write(s)
    next_inp = globals['pending'].pop(0)
    # update sliders with next_inp
    slider_param = apply_input(next_inp)
    Genome = getGenome()
    updateSliders(slider_param)

elif globals['optimizer'].stop() and not globals['stop']:
    if Shading is None:
        Shading = 0
    SDA, ASE, WWR, Shading, Glare, Window_size, udi, udif, udia, udie, wh, ww, rh, rw = map(float, [SDA, ASE, WWR, Shading, Glare, window_size, UDI, UDIF, UDIA, UDIE, window_height, window_width, room_height, room_width])
    #globals['previous_Genome'] = Genome
    value = eval_fun(SDA, ASE, WWR, Shading, Glare, Window_size, udi, udif, udia, udie, wh, ww, rh, rw)
    s = "iterator " + str(globals['iterator']) + ": SDA: " + str(SDA) +' ASE: ' + str(ASE) + ' Window Size: ' + str(Window_size) + ' Shading: ' + str(Shading) + ' Glare: ' + str(Glare) + ' UDI: ' + str(udi) + ' udif: ' + str(udif) + ' udia: ' + str(udia) + ' udie: ' + str(udie) + ' best_f_val ' + str(globals['best_f_val']) + ' Eval_fn: ' + str(value) +'\n'
    print(s)
    lf = open(logger_filename, 'a')
    #lf.write("Final Answer \n")
    lf.write(s)
    lf.close()
    next_inp = globals['best_x']
    globals['stop'] = True
    slider_param = apply_input(next_inp)
    Genome = getGenome()
    updateSliders(slider_param)
    
elif globals['optimizer'].stop() and not globals['stop'] and globals['best_f_val'] != float("inf"):
    next_inp = globals['best_x']
    lf = open(logger_filename, 'a')
    lf.write('the semi-final block has been reached\n')
    lf.close()
    globals['best_f_val'] = float("inf")
    slider_param = apply_input(next_inp)
    Genome = getGenome()
    updateSliders(slider_param)
else:
    print(globals['best_f_val'])
    Genome = getGenome()
"""
elif globals['stop']:
    Genome = getGenome()
    
"""
# ---------- end python_3 ----------
panel_11 = Panel(python_2.out)
panel_12 = Panel(python_3.out)
panel_13 = Panel(python_3.Genome)

# ----
# 1. tap a folder address to save data
folder_address = Panel("C:\Users\manal2\Documents\Fall 2022\Lighting optimization\CS_data_output\NewYork")
aggregator = ColibriAggregator(
    Folder=folder_address,
    IterationGenomeID=python_3.Genome,
    IterationPhenomeResults=parameters,
    ImgSetting=flatten(image_setting),
    Write=toggle_2,
    recordingMode=3)

# ==== cluster GHPythonRemote: Connects the Grasshopper Python component to an external Python instance.
python = PythonScript()  # -> gh_parent_doc_dir
# ---------- python: Python ----------
from os import path

gh_parent_doc_dir = path.abspath(path.dirname(ghenv.Component.OnPingDocument().Owner.OnPingDocument().FilePath))
# ---------- end python ----------
# GH to python remote example.
# Pierre Cuvilliers, 2017-2018
# Released under the MIT license
# github.com/pilcru/ghpythonremote
# Runs and connects to an external python engine, and
# assigns imported modules to scriptcontext.sticky variables.
# 
# Arguments:
#       code (str): Path to the GH_to_python_sticky.py code file.
#       location (str): Path to a python executable, or to a folder
#             containing `python.exe`, or the name of a conda-created
#             virtual environment prefixed by `conda://` (`conda://env_name`).
#             If empty, finds python from your windows %PATH%.
#       run (boolean): Creates the connection, and imports new
#             modules, when turned to True. Kills the connection,
#             and deletes the references to the imports, when turned
#             to False.
#       modules (str list): List of module names to import in the
#             remote python. They will be added to the
#             scriptcontext.sticky dictionary, allowing them to be
#             reused from other python components in the same
#             Grasshopper document. Submodules (for example
#             `numpy.linalg` have to be added explicitly to this list
#             to be available later.
#       log_level (str from ['NOTSET', 'DEBUG', 'INFO', 'WARNING', 'ERROR', 'CRITICAL']):
#             Logging level to use for the local IronPython and the
#             remote python instance.
#       working_dir (str): Working directory for the remote python
#             instance.
# 
# Returns:
#       out (str): Console output with DEBUG information.
#       linked_modules (str list): list of imported module names.
#       rpy (rpyc connection object): The object representing the
#             remote Python interpreter.
location = ClusterInput()  # location (str): Path to a python executable, or to a folder containing `python.exe`, or the name of a conda-created virtual environment prefixed by `conda://` (`conda://env_name`). If empty, finds python from your windows %PATH%.
run = ClusterInput()  # run (boolean): Creates the connection, and imports new modules, when turned to True. Kills the connection,and deletes the references to the imports, when turned to False.
modules = ClusterInput()  # modules (str list): List of module names to import in the remote python. They will be added to the scriptcontext.sticky dictionary, allowing them to be reused from other python components in the same Grasshopper document. Submodules (for example `numpy.linalg` have to be added explicitly to this list to be available later.
list = ValueList({"CRITICAL", "ERROR", "WARNING", "INFO", "DEBUG", "NOTSET"}, selected="DEBUG")
panel = Panel(python)
ghpythonremote = GHPythonRemote(location=location, run=run, modules=modules, log_level=list, working_dir=panel)  # -> out, linked_modules, rpy; inputs run: Boolean, modules: list
# ---------- ghpythonremote: Python ----------
import inspect
import logging
from os import path
import sys
from time import sleep

import scriptcontext

import ghpythonremote
from ghpythonremote.connectors import GrasshopperToPythonRemote

local_log_level = getattr(logging, log_level, logging.WARNING)
logger = logging.getLogger("ghpythonremote")
logger.setLevel(local_log_level)
ch = logging.StreamHandler()
ch.setLevel(local_log_level)
formatter = logging.Formatter("%(levelname)s: %(name)s:\n%(message)s")
ch.setFormatter(formatter)
logger.handlers = []
logger.addHandler(ch)
logger = logging.getLogger("ghpythonremote.GH_to_python")

ROOT = path.abspath(path.dirname(inspect.getfile(ghpythonremote)))
rpyc_server_py = path.join(ROOT, "pythonservice.py")

# Set connection to CLOSED if this is the first run
# and initialize set of linked modules
try:
    remote_python_status
except NameError:
    remote_python_status = "CLOSED"
    lkd_modules = set()

# Wait for connection to connect or terminate
timer = 0
while remote_python_status == "CONNECTING" or remote_python_status == "CLOSING":
    sleep(1)
    timer += 1
    if timer == 10:
        try:
            gh2py_manager.__exit__(*sys.exc_info())
        except Exception:
            pass
        remote_python_status = "CLOSED"
        lkd_modules = set()
        raise RuntimeError(
            "Connection left in an inconsistent state and not returning. Reset "
            "everything."
        )

if run:
    if not remote_python_status == "OPEN":
        remote_python_status = "CONNECTING"
        gh2py_manager = GrasshopperToPythonRemote(
            rpyc_server_py,
            location=location,
            timeout=10,
            port=None,
            log_level=log_level,
            working_dir=working_dir,
        )
        gh2py = gh2py_manager.__enter__()
        remote_python_status = "OPEN"

    # Stuff that we can reach
    rpymod = gh2py.py_remote_modules  # A getter function for a named python module
    rpy = gh2py.connection  # Represents the remote instance root object
    scriptcontext.sticky["rpy"] = rpy
    # Add modules
    for mod in modules:
        try:
            scriptcontext.sticky[mod] = rpymod(mod)
            lkd_modules.add(mod)
        except ImportError:
            gh2py_manager.__exit__(*sys.exc_info())
            raise

elif not remote_python_status == "CLOSED":
    remote_python_status = "CLOSING"
    # Remove linked modules
    for mod in lkd_modules:
        del scriptcontext.sticky[mod]
    del scriptcontext.sticky["rpy"]
    gh2py_manager.__exit__(*sys.exc_info())
    lkd_modules = set()
    remote_python_status = "CLOSED"

# Change variable name because ghpython resets outputs to None before each run
linked_modules = lkd_modules

logger.info("GH to python connection is {}".format(remote_python_status))
# ---------- end ghpythonremote ----------
out = ClusterOutput(ghpythonremote.out)  # Console output.
linked_modules = ClusterOutput(ghpythonremote.linked_modules)  # Names of modules that were successfully added to the scriptcontext.sticky dictionary.
rpy = ClusterOutput(ghpythonremote.rpy)  # The object representing the remote python instance
python_2 = PythonScript(module_names=ghpythonremote.linked_modules)  # -> import_statements; inputs module_names: list
# ---------- python_2: Python ----------
import_statements = ["import scriptcontext as sc"]
for module_name in module_names:
    import_statements.append("{0} = sc.sticky['{0}']".format(module_name))

if len(module_names) == 0:
    import_statements = []
# ---------- end python_2 ----------
import_statements = ClusterOutput(python_2)  # Useful import statements to use the imported modules in your scripts.
